# Dynamo graph PAR_AddShared_IFC_Parameters.dyn (Dynamo 2.3.0.5885)
# packages: Data-Shapes 2019.2.42, Clockwork for Dynamo 2.x 2.3.0, Orchid 230.0.2.7458

# group: AddShared_IFC_Parameters
# note: June 2020
# Made by Menno Mekes
# Information Model Builder at:
# Arons en Gelauff architecten
# Gedempt Hamerkanaal 92
# 1021 KR Amsterdam
# www.aronsengelauff.nl
# This Graph is free for you to (ab)use!
# So yes, also commercial and educational... :-)
# Just don't expect a helpdesk and don't come knocking when it doesn't work.
# It's Dynamo you know :-)
# More information and explaination here:
# < LinkedIn link>

# group: read current shared parameter file, set the correct one
sharedParameterFile = Parameter.SharedParameterFile()
watch = Watch(sharedParameterFile)
file_path_to_ifc_shared = Filename("K:\IFC Shared Parameters-RevitIFCBuiltIn_ALL.txt")  # "File Path to: IFC Shared Parameters-RevitIFCBuiltIn_ALL.txt"; graph input
# note: Custom Node: Clockwork v.2.3.0
passthrough = Custom[Passthrough](passThrough=file_path_to_ifc_shared, waitFor=sharedParameterFile)  # package Clockwork for Dynamo 2.x; Forces a sequential order of execution. The node wired into the output of the Passthrough node will be executed *after* the node wired into the waitFor input (e.g. important for some Revit operations). The value of the passThrough input will be passed on to the node wired into the output port of the Passthrough node.
# note: Custom Node: Orchid
#    v. 230.0.2.7458
setFile = Orchid.RevitProject.Parameters.SharedParameter.SetFile(file=passthrough)

watch_2 = Watch()  # frozen; unwired: arg0

# group: Get sheetnames and split Entities and Enums
file_path_to_par_addshared_ifc = Filename(".\PAR_AddShared_IFC_Parameters.xlsx")  # "File Path to: PAR_AddShared_IFC_Parameters.xlsx"; graph input
# note: Skip the first 5 sheets.
# Sheets 1 and 2 are 'Variables' and 'Parameters' and are needed as input for the Entity-sheets.
# Sheets 3-5 are 'IfcDoor', 'IfcWindow' and 'DoorWindowPsets' and are not used in this Graph.
# Door-, and Windowfamilies must be their own Revit Category. Instead of IfcExportAs and IfcExportType the parameters 'Construction' and 'Operation' are needed.
# And, when there is Glazing involved two extra Psets are created. So: too much difference with how  this graph works.
# Same for Lining and Panels.
# note: Custom Node: Data-Shapes v.2019.2.42
worksheets = Custom[Excel.Worksheets](FilePath=file_path_to_par_addshared_ifc)  # package Data-Shapes; Gets worksheet names from specified Excel workbook.
code_block = CodeBlock { 0..4; }
removeItemAtIndex = List.RemoveItemAtIndex(list=worksheets, indices=code_block)
code_block_2 = CodeBlock { "."; }
contains = String.Contains(str=removeItemAtIndex, searchFor=code_block_2)
filterByBoolMask = List.FilterByBoolMask(list=removeItemAtIndex, mask=contains)

# group: Choose Entity
string = StringInput("Choose Ifc-entity")
file_path = Filename(".\AG_DYN_logo.jpg")
code_block_3 = CodeBlock { "next"; }
# note: Custom Node: Data-Shapes v.2019.2.42
ui_radiobuttons_data = Custom[UI.RadioButtons Data](Keys=filterByBoolMask.out, Values=filterByBoolMask.out)  # package Data-Shapes; Create radio buttons input for UI.MultipleInputForm ++ .
boolean = BoolSelector(true)
# note: Maxheight is needed when you create a list with a lot of inputs. The inputs will run off the bottom of the screen. When setting a MAxheight you get a scroll-bar instead.
code_block_4 = CodeBlock { 750; 500; }
ui_multipleinputform = Custom[UI.MultipleInputForm ++](Description_optional=string, Logo_optional=file_path, ButtonText_optional=code_block_3, Inputs=ui_radiobuttons_data, Toggle=boolean, MaxHeight_optional=code_block_4.out0, Width_optional=code_block_4.out1)  # package Data-Shapes; Create a form with multiple inputs. see www.data-shapes.net for tutorials and infos!

# group: Import Excel
file_from_path = FileObject(path=file_path_to_par_addshared_ifc)
boolean_2 = BoolSelector(false)
importExcel = Data.ImportExcel(file=file_from_path, sheetName=ui_multipleinputform.User_Inputs, readAsStrings=boolean_2, showExcel=boolean_2)

code_block_5 = CodeBlock { 1; }
flatten = List.Flatten(list=importExcel, amt=code_block_5)

# group: Get enumerations from sheet
# note: Get the first item.
# Find wich index contains ENUMERATIONS and remove indices 0 until and including the ENUMERATIONS.
code_block_6 = CodeBlock { 0; }
getItemAtIndex = List.GetItemAtIndex(list=flatten, index=code_block_6, lacing=Longest)
code_block_7 = CodeBlock { "ENUMERATIONS"; }
indexOf = List.IndexOf(list=getItemAtIndex, element=code_block_7@L2)
code_block_8 = CodeBlock(ENUMS=indexOf) { 0..ENUMS; }
removeItemAtIndex_2 = List.RemoveItemAtIndex(list=getItemAtIndex@L2, indices=code_block_8)
# note: Enumerations + it's Properties
# if they are in the Pset.
flatten_2 = List.Flatten(list=removeItemAtIndex_2)
firstItem = List.FirstItem(list=flatten_2)
toUpper = String.ToUpper(str=flatten_2)
eq = flatten_2 == toUpper
filterByBoolMask_2 = List.FilterByBoolMask(list=flatten_2, mask=eq)
# note: choice for enumerations
join = List.Join(list0=firstItem, list1=filterByBoolMask_2.in)

# group: get properties for the chosen Entity
code_block_9 = CodeBlock(ENUMS=indexOf) { 0..ENUMS-1; }
flatten_3 = List.Flatten(list=code_block_9)
getItemAtIndex_2 = List.GetItemAtIndex(list=flatten, index=flatten_3@L2)

# group: enum kiezen
string_2 = StringInput("Choose an ENUMERATION")
file_path_2 = Filename(".\AG_DYN_logo.jpg")
code_block_10 = CodeBlock { "next"; }
# note: Custom Node: Data-Shapes v.2019.2.42
ui_radiobuttons_data_2 = Custom[UI.RadioButtons Data](Keys=join, Values=join)
boolean_3 = BoolSelector(true)
code_block_11 = CodeBlock { 750; 500; }
ui_multipleinputform_2 = Custom[UI.MultipleInputForm ++](Description_optional=string_2, Logo_optional=file_path_2, ButtonText_optional=code_block_10, Inputs=ui_radiobuttons_data_2, Toggle=boolean_3, MaxHeight_optional=code_block_11.out0, Width_optional=code_block_11.out1)

# group: Get properties for Pset dictated by the chosen enumeration.
code_block_12 = CodeBlock { "No extra properties"; }
flatten_4 = List.Flatten(list=getItemAtIndex)
indexOf_2 = List.IndexOf(list=flatten_4, element=join)
indexOf_3 = List.IndexOf(list=flatten_4, element=ui_multipleinputform_2.User_Inputs)
indexOf_4 = List.IndexOf(list=indexOf_2, element=indexOf_3)
# note: NOTDEFINED is the last item in the list. So +1 won't work. therefor: If NOTDEFINED is chosen: +0, otherwise +1
code_block_13 = CodeBlock { "NOTDEFINED"; }
eq_2 = ui_multipleinputform_2.User_Inputs == code_block_13
code_block_14 = CodeBlock { 0; 1; }
if_ = If(test=eq_2, true=code_block_14.out0, false=code_block_14.out1)
code_block_15 = CodeBlock(enum=indexOf_4, addition=if_) { enum+addition; }
getItemAtIndex_3 = List.GetItemAtIndex(list=indexOf_2, index=code_block_15)
code_block_16 = CodeBlock(chosen_enum=indexOf_3, addition=if_) { chosen_enum+addition; }
code_block_17 = CodeBlock(next_enum=getItemAtIndex_3, chosen_enum_properties=code_block_16) { next_enum-chosen_enum_properties; }
code_block_18 = CodeBlock { 0; }
eq_3 = code_block_17 == code_block_18
# note: Finding the indices of the properties:
# get the index of the chosen enumerataion and the next one.
# subtract the second one from the first one to find out how many properties the chosen enumeration has and get those from the complete list.
code_block_19 = CodeBlock(choosen_enum=indexOf_3, x=code_block_17) { choosen_enum+[1..x]; }
# note: When there are none an error occurs with the GetItemAtIndex. So two if-statements are used to get the desired result.
# Later the 'No extra properties' string will be deleted before adding the parameters.
if_2 = If(test=eq_3, true=code_block_17, false=code_block_19)
flatten_5 = List.Flatten(list=if_2)
getItemAtIndex_4 = List.GetItemAtIndex(list=flatten, index=flatten_5@L2)
list_create = List.Create(item0=code_block_12, item1=getItemAtIndex_4)
code_block_20 = CodeBlock { 0; 1; }
if_3 = If(test=eq_3, true=code_block_20.out0, false=code_block_20.out1)
getItemAtIndex_5 = List.GetItemAtIndex(list=list_create, index=if_3)

# group: Properties list to be added to the Family.
code_block_21 = CodeBlock { 1; }
# note: join both lists to get alle the neccesary parameters.
flatten_6 = List.Flatten(list=getItemAtIndex_5, amt=code_block_21)
# note: Create 2 options.
# 0 = just the entities own properties
# 1 = entities own properties + enumeration properties.
join_2 = List.Join(list0=getItemAtIndex_2, list1=flatten_6)
list_create_2 = List.Create(item0=getItemAtIndex_2, item1=join_2)
getItemAtIndex_6 = List.GetItemAtIndex(list=list_create_2, index=if_3)

# group: Gather inputs for Parameter.AddSharedParameter-node
code_block_22 = CodeBlock { 0; 1; 2; 3; 4; 5; }
getItemAtIndex_7 = List.GetItemAtIndex(list=getItemAtIndex_6@L2, index=code_block_22.out0)
sort = List.Sort(list=getItemAtIndex_7)
getItemAtIndex_8 = List.GetItemAtIndex(list=getItemAtIndex_6@L2, index=code_block_22.out4)
indexOf_5 = List.IndexOf(list=getItemAtIndex_7, element=sort)
getItemAtIndex_9 = List.GetItemAtIndex(list=getItemAtIndex_8, index=indexOf_5)
code_block_23 = CodeBlock { 1; }
eq_4 = getItemAtIndex_9 == code_block_23
getItemAtIndex_10 = List.GetItemAtIndex(list=getItemAtIndex_6@L2, index=code_block_22.out1)
getItemAtIndex_11 = List.GetItemAtIndex(list=getItemAtIndex_10, index=indexOf_5)
getItemAtIndex_12 = List.GetItemAtIndex(list=getItemAtIndex_6@L2, index=code_block_22.out2)
getItemAtIndex_13 = List.GetItemAtIndex(list=getItemAtIndex_12, index=indexOf_5)
getItemAtIndex_14 = List.GetItemAtIndex(list=getItemAtIndex_6@L2, index=code_block_22.out3)
getItemAtIndex_15 = List.GetItemAtIndex(list=getItemAtIndex_14, index=indexOf_5)
getItemAtIndex_16 = List.GetItemAtIndex(list=getItemAtIndex_6@L2, index=code_block_22.out5)
getItemAtIndex_17 = List.GetItemAtIndex(list=getItemAtIndex_16, index=indexOf_5)
eq_5 = getItemAtIndex_17 == code_block_23

# group: Last minute Instance/Type changes
boolean_4 = BoolSelector(false)
count = List.Count(list=eq_4)
cycle = List.Cycle(list=boolean_4, amount=count)
string_3 = StringInput("Instance if box is checked")
file_path_3 = Filename(".\AG_DYN_logo.jpg")
code_block_24 = CodeBlock { "next"; }
# note: Instance / Type is set in the XLS-file. This is the most common used setting for you. However, especially when associating parameters, you might want to change a Type-parameter into an Instance for instance.
# If you want to do that in the excel and only there, get rid of this group.
# I like to be able to choose without opening the excel. Hence the extra dialog box.
# The values from excel are set in the list.
# Check or uncheck what you like.
code_block_25 = CodeBlock { 200; }
boolean_5 = BoolSelector(true)
allIndicesOf = List.AllIndicesOf(list=eq_4, item=boolean_5)
# note: Custom Node: Data-Shapes v.2019.2.42
ui_listview_data = Custom[UI.Listview Data](InputName=ui_multipleinputform_2.User_Inputs, Keys=sort, Values=sort, Height_optionnal=code_block_25, DefaultValueIndices_optionnal=allIndicesOf)  # package Data-Shapes; Create data for ListView input in UI.MultiInputForm ++ . Check out www.data-shapes.net for more infos.
boolean_6 = BoolSelector(true)
code_block_26 = CodeBlock { 750; 500; }
ui_multipleinputform_3 = Custom[UI.MultipleInputForm ++](Description_optional=string_3, Logo_optional=file_path_3, ButtonText_optional=code_block_24, Inputs=ui_listview_data, Toggle=boolean_6, MaxHeight_optional=code_block_26.out0, Width_optional=code_block_26.out1)
list_create_3 = List.Create(item0=ui_multipleinputform_3.User_Inputs, item1=cycle)
# note: Not so straight forward as you might think. When all boxes are unchecked the output of this node is an Empty List. This will get us yellow nodes and no Parameters :-(
# To fix this an if-node is placed and used in a way it work when it otherwise doesn's. I do this more often when an if doesn't work:
# Above the List.IsEmpty there is a List Create. Item 1 is the if result when true. Item 0 is the if result when false. Feeding these two directly into the if node doesn't work. Hence the workaround to say true is 1, false is 0 so we can get the items at the if-result-index.
isEmpty = List.IsEmpty(list=ui_multipleinputform_3.User_Inputs, lacing=Longest)
code_block_27 = CodeBlock { 1; 0; }
if_4 = If(test=isEmpty, true=code_block_27.out0, false=code_block_27.out1)
# note: This list says: All parameters are Type.
# Unchecking a parameter (meaning you want this parameter to be Type instead of Instance) doesn't change a thing.
flatten_7 = List.Flatten(list=if_4)
getItemAtIndex_18 = List.GetItemAtIndex(list=list_create_3, index=flatten_7)
indexOf_6 = List.IndexOf(list=sort, element=getItemAtIndex_18)
boolean_7 = BoolSelector(true)
# note: OOTB node creates a list for every index.
# Clockwork uses the input to replace the indices in the one list.
# note: Custom Node: Clockwork v.2.3.0
replaceItemAtIndex = Custom[List.ReplaceItemAtIndex+](seq=cycle, indices=indexOf_6, replacement=boolean_7)  # package Clockwork for Dynamo 2.x; Replaces the item at a given index of a list by another item. Unlike the OOTB node, it can replace items at multiple indeces.
list_create_4 = List.Create(item0=replaceItemAtIndex, item1=cycle)
getItemAtIndex_19 = List.GetItemAtIndex(list=list_create_4, index=flatten_7)
flatten_8 = List.Flatten(list=getItemAtIndex_19)

# group: IN = Instance OUT = Type
# note: This Graph started out like this:
# https://www.youtube.com/watch?v=6Az1G0pla_k&t=327s
# In this video Gavin explained that the 'Parameter.AddSharedParameter'-node only works (or works best) with the 'Document.Current' from Orchid.
# note: Custom Node: Orchid
#    v. 230.0.2.7458
current = Orchid.RevitProject.Common.Document.Current()
filterByBoolMask_3 = List.FilterByBoolMask(list=sort, mask=flatten_8)
filterByBoolMask_4 = List.FilterByBoolMask(list=getItemAtIndex_11, mask=flatten_8)
filterByBoolMask_5 = List.FilterByBoolMask(list=getItemAtIndex_13, mask=flatten_8)
filterByBoolMask_6 = List.FilterByBoolMask(list=getItemAtIndex_15, mask=flatten_8)
filterByBoolMask_7 = List.FilterByBoolMask(list=flatten_8, mask=flatten_8)
filterByBoolMask_8 = List.FilterByBoolMask(list=eq_5, mask=flatten_8)

# group: create paramters, first instance then, after setting the [Type] parameter-file, the Type parameters.
# note: Custom Node: Orchid
#    v. 230.0.2.7458
add = Orchid.RevitFamily.SharedParameter.Add(familyDocument=current, parameterName=filterByBoolMask_3.in, groupName=filterByBoolMask_4.in, type=filterByBoolMask_5.in, group=filterByBoolMask_6.in, instance=filterByBoolMask_7.in, reporting=filterByBoolMask_8.in, lacing=Longest)
code_block_28 = CodeBlock(parametername=filterByBoolMask_3.out) { parametername+"[Type]"; }

# group: After setting instance parameters change to the [Type]-parameterfile
file_path_to_ifc_shared_2 = Filename("K:\IFC Shared Parameters-RevitIFCBuiltIn-Type_ALL.txt")  # "File Path to: IFC Shared Parameters-RevitIFCBuiltIn-Type_ALL.txt"; graph input
# note: Custom Node: Clockwork v.2.3.0
passthrough_2 = Custom[Passthrough](passThrough=file_path_to_ifc_shared_2, waitFor=add)
# note: Custom Node: Orchid
#    v. 230.0.2.7458
setFile_2 = Orchid.RevitProject.Parameters.SharedParameter.SetFile(file=passthrough_2)

# group (continued): create paramters, first instance then, after setting the [Type] parameter-file, the Type parameters.
# note: Custom Node: Clockwork v.2.3.0
passthrough_3 = Custom[Passthrough](passThrough=code_block_28, waitFor=setFile_2)
add_2 = Orchid.RevitFamily.SharedParameter.Add(familyDocument=current, parameterName=passthrough_3, groupName=filterByBoolMask_4.out, type=filterByBoolMask_5.out, group=filterByBoolMask_6.out, instance=filterByBoolMask_7.out, reporting=filterByBoolMask_8.out, lacing=Longest)

# group: Combine the parameters and get the IfcExportAs and IfcExportType parameters.
join_3 = List.Join(list0=add, list1=add_2)
# note: Custom Node: Orchid
#    v. 230.0.2.7458
name = Orchid.RevitFamily.Parameter.Name(parameter=join_3)
string_4 = StringInput("""IfcExportAs
IfcExportType""")
string_5 = StringInput("\n")
split = String.Split(str=string_4, separator0=string_5)
contains_2 = String.Contains(str=name, searchFor=split@L2, lacing=Longest)

anyTrue = Orchid.Common.List.AnyTrue(list=contains_2)

# group (continued): Combine the parameters and get the IfcExportAs and IfcExportType parameters.
filterByBoolMask_9 = List.FilterByBoolMask(list=name, mask=anyTrue)

# group: Set IfcExportAs and IfcExportType by setting the fomula.
# note: Custom Node: Clockwork v.2.3.0
passthrough_4 = Custom[Passthrough](passThrough=current, waitFor=add)
string_6 = StringInput("\"")
code_block_29 = CodeBlock { "< Empty >"; " "; }
eq_6 = ui_multipleinputform_2.User_Inputs == code_block_29.out0
if_5 = If(test=eq_6, true=code_block_29.out1, false=ui_multipleinputform_2.User_Inputs)
join_4 = List.Join(list0=ui_multipleinputform.User_Inputs, list1=if_5)
# note: Since """ doesn't work....
code_block_30 = CodeBlock(quotationmark=string_6, typeandenumeration=join_4) { quotationmark+typeandenumeration+quotationmark; }
# note: Custom Node: Orchid
#    v. 230.0.2.7458
set = Orchid.RevitFamily.Formula.Set(familyDocument=passthrough_4, parameterName=filterByBoolMask_9.in, value=code_block_30)

# group: restore shared parameterfile that was active before running.
# note: Custom Node: Clockwork v.2.3.0
passthrough_5 = Custom[Passthrough](passThrough=sharedParameterFile, waitFor=add_2)
# note: Custom Node: Orchid
#    v. 230.0.2.7458
setFile_3 = Orchid.RevitProject.Parameters.SharedParameter.SetFile(file=passthrough_5)
