# Dynamo graph PAR_AddShared_IFC_Parameters_DoorWindow.dyn (Dynamo 2.3.0.5885)
# packages: Orchid 230.0.1.7333, Data-Shapes 2019.2.42, Clockwork for Dynamo 2.x 2.3.0, Orchid 230.0.1.7410, Orchid 230.0.1.7364, spring nodes 203.2.0, Orchid 230.0.2.7458

# group: AddShared_IFC_Parameters
# note: June 2020
# Made by Menno Mekes
# Information Model Builder at:
# Arons en Gelauff architecten
# Gedempt Hamerkanaal 92
# 1021 KR Amsterdam
# www.aronsengelauff.nl
# This Graph is free for you to (ab)use!
# So yes, also commercial and educational... :-)
# Just don't expect a helpdesk and don't come knocking when it doesn't work.
# It's Dynamo you know :-)
# More information and explaination here:
# < LinkedIn link>

# group: read current shared parameter file, set the correct one
sharedParameterFile = Parameter.SharedParameterFile()
watch = Watch(sharedParameterFile)
# note: Custom Node: Orchid
#    v. 230.0.2.7458
current = Orchid.RevitProject.Common.Document.Current()
file_path_to_ifc_shared = Filename("..\..\..\..\..\REVIT\IFC Shared Parameters-RevitIFCBuiltIn_ALL.txt")  # "File Path to: IFC Shared Parameters-RevitIFCBuiltIn_ALL.txt"; graph input
# note: Custom Node: Clockwork v.2.3.0
passthrough = Custom[Passthrough](passThrough=file_path_to_ifc_shared, waitFor=sharedParameterFile)  # package Clockwork for Dynamo 2.x; Forces a sequential order of execution. The node wired into the output of the Passthrough node will be executed *after* the node wired into the waitFor input (e.g. important for some Revit operations). The value of the passThrough input will be passed on to the node wired into the output port of the Passthrough node.
setFile = Orchid.RevitProject.Parameters.SharedParameter.SetFile(file=passthrough)

# group: Read sheetnames
file_path_to_par_addshared_ifc = Filename(".\PAR_AddShared_IFC_Parameters.xlsx")  # "File Path to: PAR_AddShared_IFC_Parameters.xlsx"; graph input
# note: Custom Node: Data-Shapes v.2019.2.42
worksheets = Custom[Excel.Worksheets](FilePath=file_path_to_par_addshared_ifc)  # package Data-Shapes; Gets worksheet names from specified Excel workbook.

# group: Import Excel
file_from_path = FileObject(path=file_path_to_par_addshared_ifc)
code_block = CodeBlock { 2..4; }
getItemAtIndex = List.GetItemAtIndex(list=worksheets, index=code_block)
boolean = BoolSelector(false)
importExcel = Data.ImportExcel(file=file_from_path, sheetName=getItemAtIndex, readAsStrings=boolean, showExcel=boolean)

# group: User input
string = StringInput("DoorWindow options")
file_path = Filename(".\AG_DYN_logo.jpg")
string_2 = StringInput("Choose Ifc-entity")
code_block_2 = CodeBlock { 2..3; }
getItemAtIndex_2 = List.GetItemAtIndex(list=worksheets, index=code_block_2)
# note: Custom Node: Data-Shapes v.2019.2.42
ui_radiobuttons_data = Custom[UI.RadioButtons Data](InputName=string_2, Keys=getItemAtIndex_2, Values=getItemAtIndex_2)  # package Data-Shapes; Create radio buttons input for UI.MultipleInputForm ++ .
string_3 = StringInput("optional options:")
string_4 = StringInput("""Panel
Lining
Glazing""")
string_5 = StringInput("\n")
split = String.Split(str=string_4, separator0=string_5)
ui_listview_data = Custom[UI.Listview Data](InputName=string_3, Keys=split, Values=split)  # package Data-Shapes; Create data for ListView input in UI.MultiInputForm ++ . Check out www.data-shapes.net for more infos.
string_6 = StringInput("""Operation enumeration:
(panel only works if panel is chosen in options)""")
string_7 = StringInput("""DoorWindow
Panel""")
string_8 = StringInput("\n")
split_2 = String.Split(str=string_7, separator0=string_8)
ui_radiobuttons_data_2 = Custom[UI.RadioButtons Data](InputName=string_6, Keys=split_2, Values=split_2)
join = List.Join(list0=ui_radiobuttons_data, list1=ui_listview_data, list2=ui_radiobuttons_data_2)
ui_inputgroup_data = Custom[UI.InputGroup Data](Inputs=join)  # package Data-Shapes; Creates a group of inputs for UI.MultipleInputForm ++ . Check out www.data-shapes.net for more infos !
boolean_2 = BoolSelector(true)
code_block_3 = CodeBlock { 750; 400; }
ui_multipleinputform = Custom[UI.MultipleInputForm ++](Description_optional=string, Logo_optional=file_path, Inputs=ui_inputgroup_data, Toggle=boolean_2, MaxHeight_optional=code_block_3.out0, Width_optional=code_block_3.out1)  # package Data-Shapes; Create a form with multiple inputs. see www.data-shapes.net for tutorials and infos!
# note: IFcDoor or IfcWindow
firstItem = List.FirstItem(list=ui_multipleinputform.User_Inputs)

# group: get properties from sheet DoorWindowPsets
code_block_4 = CodeBlock { 2; }
# note: sheet: DoorWindowPsets
getItemAtIndex_3 = List.GetItemAtIndex(list=importExcel, index=code_block_4)
# note: Get only the first column
code_block_5 = CodeBlock { 0; }
getItemAtIndex_4 = List.GetItemAtIndex(list=getItemAtIndex_3@L2, index=code_block_5)
string_9 = StringInput("""Pset_DoorWindowGlazingType
Pset_DoorWindowShadingType
IfcDoorLiningProperties
IfcDoorPanelProperties
IfcWindowLiningProperties
IfcWindowPanelProperties""")
string_10 = StringInput("\n")
split_3 = String.Split(str=string_9, separator0=string_10)
indexOf = List.IndexOf(list=getItemAtIndex_4, element=split_3)
code_block_6 = CodeBlock(index=indexOf) { index+1; }
restOfItems = List.RestOfItems(list=indexOf)
count = List.Count(list=getItemAtIndex_4)
join_2 = List.Join(list0=restOfItems, list1=count)
code_block_7 = CodeBlock(count=join_2) { count-1; }
code_block_8 = CodeBlock { 1; }
range = Range(start=code_block_6, end=code_block_7, step=code_block_8)
getItemAtIndex_5 = List.GetItemAtIndex(list=getItemAtIndex_4, index=range)

# group: Get desired indices
string_11 = StringInput("""IfcDoorGlazing
IfcWindowGlazing
IfcDoorLining
IfcDoorPanel
IfcWindowLining
IfcWindowPanel""")
string_12 = StringInput("\n")
split_4 = String.Split(str=string_11, separator0=string_12)
code_block_9 = CodeBlock { 0..1; 0..1; 2; 3; 4; 5; }
list_create = List.Create(item0=code_block_9.out0, item1=code_block_9.out1, item2=code_block_9.out2, item3=code_block_9.out3, item4=code_block_9.out4, item5=code_block_9.out5)
code_block_10 = CodeBlock { 1; }
getItemAtIndex_6 = List.GetItemAtIndex(list=ui_multipleinputform.User_Inputs, index=code_block_10)
code_block_11 = CodeBlock(entity=firstItem, psets=getItemAtIndex_6) { entity+psets; }
# note: Custom Node: spring nodes v.203.2.0
ꟿ_dictionary_bykeysvalues = Custom[ꟿ Dictionary.ByKeysValues](keys=split_4, values=list_create, searchKeys=code_block_11)  # package spring nodes; Dictionaries are an incredibly powerful tool for making associative sets between two equal length lists. The first list must be of unique strings (or numbers) and will be the key and the second list will be the matching values (it can be made up of geometry, elements, even other lists) The search keys list will provide the corresponding value to the input key.
# note: Get desired indices
flatten = List.Flatten(list=ꟿ_dictionary_bykeysvalues)

# group: unmerations input
# note: firstitem is either IfcDoor or IfcWindow
indexOf_2 = List.IndexOf(list=getItemAtIndex, element=firstItem)
# note: properties for Pset_DoorCommon or Pset_WindowCommon
getItemAtIndex_7 = List.GetItemAtIndex(list=importExcel, index=indexOf_2)
code_block_12 = CodeBlock { 0; }
# note: Get only the first column
code_block_13 = CodeBlock { 0; }
getItemAtIndex_8 = List.GetItemAtIndex(list=getItemAtIndex_7@L2, index=code_block_13)
string_13 = StringInput("""StyleConstructionEnum
StyleOperationEnum
PanelOperationEnum""")
string_14 = StringInput("\n")
split_5 = String.Split(str=string_13, separator0=string_14)
# note: Find these 3 lines:
code_block_14 = CodeBlock(entity=firstItem, enums=split_5) { entity+enums; }
indexOf_3 = List.IndexOf(list=getItemAtIndex_8, element=code_block_14)
code_block_15 = CodeBlock(index=indexOf_3) { index+1; }
join_3 = List.Join(list0=code_block_12, list1=code_block_15)
count_2 = List.Count(list=getItemAtIndex_8)
join_4 = List.Join(list0=indexOf_3, list1=count_2)
code_block_16 = CodeBlock(count=join_4) { count-1; }
code_block_17 = CodeBlock { 1; }
range_2 = Range(start=join_3, end=code_block_16, step=code_block_17)
getItemAtIndex_9 = List.GetItemAtIndex(list=getItemAtIndex_7, index=range_2)
firstItem_2 = List.FirstItem(list=getItemAtIndex_9)
code_block_18 = CodeBlock { "extra index so we can use the same index that is the If-result"; }
join_5 = List.Join(list0=code_block_18, list1=code_block_14)
# note: input for operation.
# If panel is not checked in the first dialog box, IfcDoor/IfcWindowStyleOperationEnum is chosen,
# If Panel is checked, IfcDoor/IfcWindowPanelOperationEnum is chosen.
code_block_19 = CodeBlock { 1; }
# note: StyleConstructionEnum
getItemAtIndex_10 = List.GetItemAtIndex(list=join_5, index=code_block_19)
getItemAtIndex_11 = List.GetItemAtIndex(list=getItemAtIndex_8, index=range_2)
getItemAtIndex_12 = List.GetItemAtIndex(list=getItemAtIndex_11, index=code_block_19)
code_block_20 = CodeBlock { 2; }
getItemAtIndex_13 = List.GetItemAtIndex(list=ui_multipleinputform.User_Inputs, index=code_block_20)
string_15 = StringInput("Panel")
# note: If Panel is not chosen in 'optional options' but is chosen in 'enumerations' this will override.
# You cán choose IfcDoor/Window as an enumeration when choosing panel-properties (nested panel in a DoorWindow so you want to associate parameters) but not the other way around.
contains = List.Contains(list=getItemAtIndex_13, item=string_15)
# note: Panel or not?
contains_2 = List.Contains(list=getItemAtIndex_6, item=string_15)
code_block_21 = CodeBlock { 3; 2; }
if_ = If(test=contains_2, true=code_block_21.out0, false=code_block_21.out1)
code_block_22 = CodeBlock { 2; }
if_2 = If(test=contains, true=if_, false=code_block_22)
getItemAtIndex_14 = List.GetItemAtIndex(list=join_5, index=if_2)
getItemAtIndex_15 = List.GetItemAtIndex(list=getItemAtIndex_11, index=if_2)

# group: Properties list to be added to the Family.
getItemAtIndex_16 = List.GetItemAtIndex(list=getItemAtIndex_5, index=flatten)
indexOf_4 = List.IndexOf(list=getItemAtIndex_4, element=getItemAtIndex_16)
flatten_2 = List.Flatten(list=indexOf_4)
getItemAtIndex_17 = List.GetItemAtIndex(list=getItemAtIndex_3, index=flatten_2)
join_6 = List.Join(list0=firstItem_2, list1=getItemAtIndex_17)

# group: User input
string_16 = StringInput("Choose enumerations")
file_path_2 = Filename(".\AG_DYN_logo.jpg")
# note: Custom Node: Data-Shapes v.2019.2.42
ui_radiobuttons_data_3 = Custom[UI.RadioButtons Data](InputName=getItemAtIndex_10, Keys=getItemAtIndex_12, Values=getItemAtIndex_12)
ui_radiobuttons_data_4 = Custom[UI.RadioButtons Data](InputName=getItemAtIndex_14, Keys=getItemAtIndex_15, Values=getItemAtIndex_15)
join_7 = List.Join(list0=ui_radiobuttons_data_3, list1=ui_radiobuttons_data_4)
ui_inputgroup_data_2 = Custom[UI.InputGroup Data](Inputs=join_7)
boolean_3 = BoolSelector(true)
code_block_23 = CodeBlock { 700; 500; }
ui_multipleinputform_2 = Custom[UI.MultipleInputForm ++](Description_optional=string_16, Logo_optional=file_path_2, Inputs=ui_inputgroup_data_2, Toggle=boolean_3, MaxHeight_optional=code_block_23.out0, Width_optional=code_block_23.out1)

# note: last minute instance/type dialogbox cam before enumeration choice.
# not a problem but an illogical order.
# note: Custom Node: Clockwork v.2.3.0
passthrough_2 = Custom[Passthrough](passThrough=join_6, waitFor=ui_multipleinputform_2.User_Inputs)

# group: Write Shared Parameters to family
code_block_24 = CodeBlock { 0; 1; 2; 3; 4; 5; }
getItemAtIndex_18 = List.GetItemAtIndex(list=passthrough_2@L2, index=code_block_24.out0)
sort = List.Sort(list=getItemAtIndex_18)
getItemAtIndex_19 = List.GetItemAtIndex(list=passthrough_2@L2, index=code_block_24.out4)
indexOf_5 = List.IndexOf(list=getItemAtIndex_18, element=sort)
getItemAtIndex_20 = List.GetItemAtIndex(list=getItemAtIndex_19, index=indexOf_5)
code_block_25 = CodeBlock { 1; }
eq = getItemAtIndex_20 == code_block_25
getItemAtIndex_21 = List.GetItemAtIndex(list=passthrough_2@L2, index=code_block_24.out1)
getItemAtIndex_22 = List.GetItemAtIndex(list=getItemAtIndex_21, index=indexOf_5)
getItemAtIndex_23 = List.GetItemAtIndex(list=passthrough_2@L2, index=code_block_24.out2)
getItemAtIndex_24 = List.GetItemAtIndex(list=getItemAtIndex_23, index=indexOf_5)
getItemAtIndex_25 = List.GetItemAtIndex(list=passthrough_2@L2, index=code_block_24.out3)
getItemAtIndex_26 = List.GetItemAtIndex(list=getItemAtIndex_25, index=indexOf_5)
getItemAtIndex_27 = List.GetItemAtIndex(list=passthrough_2@L2, index=code_block_24.out5)
getItemAtIndex_28 = List.GetItemAtIndex(list=getItemAtIndex_27, index=indexOf_5)
eq_2 = getItemAtIndex_28 == code_block_25

# group: Last minute Instance/Type changes
boolean_4 = BoolSelector(false)
count_3 = List.Count(list=eq)
cycle = List.Cycle(list=boolean_4, amount=count_3)
string_17 = StringInput("Instance if box is checked")
file_path_3 = Filename(".\AG_DYN_logo.jpg")
code_block_26 = CodeBlock { "next"; }
# note: Instance / Type is set in the XLS-file. This is the most common used setting for you. However, especially when associating parameters, you might want to change a Type-parameter into an Instance for an instance.
# If you want to do that in the excel and only ther, get rid of this group.
# I like to be able to choose without opening the excel. Hence the extra dialog box.
# The values from excel are set in the list.
# Check or uncheck what you like.
code_block_27 = CodeBlock { 200; }
boolean_5 = BoolSelector(true)
allIndicesOf = List.AllIndicesOf(list=eq, item=boolean_5)
# note: Custom Node: Data-Shapes v.2019.2.42
ui_listview_data_2 = Custom[UI.Listview Data](Keys=sort, Values=sort, Height_optionnal=code_block_27, DefaultValueIndices_optionnal=allIndicesOf)
boolean_6 = BoolSelector(true)
code_block_28 = CodeBlock { 750; 500; }
ui_multipleinputform_3 = Custom[UI.MultipleInputForm ++](Description_optional=string_17, Logo_optional=file_path_3, ButtonText_optional=code_block_26, Inputs=ui_listview_data_2, Toggle=boolean_6, MaxHeight_optional=code_block_28.out0, Width_optional=code_block_28.out1)
list_create_2 = List.Create(item0=ui_multipleinputform_3.User_Inputs, item1=cycle)
# note: Not so straight forward as you might think. When all boxes are unchecked the output of this node is an Empty List. This will get us yellow nodes and no Parameters :-(
# To fix this an if-node is placed and used in a way it work when it otherwise doesn's. I do this more often when an if doesn't work:
# Above the List.IsEmpty there is a List Create. Item 1 is the if result when true. Item 0 is the if result when false. Feeding these two directly into the if node doesn't work. Hence the workaround to say true is 1, false is 0 so we can get the items at the if-result-index.
isEmpty = List.IsEmpty(list=ui_multipleinputform_3.User_Inputs, lacing=Longest)
code_block_29 = CodeBlock { 1; 0; }
if_3 = If(test=isEmpty, true=code_block_29.out0, false=code_block_29.out1)
# note: This list says: All parameters are Type.
# Unchecking a parameter (meaning you want this parameter to be Type instead of Instance) doesn't change a thing.
flatten_3 = List.Flatten(list=if_3)
getItemAtIndex_29 = List.GetItemAtIndex(list=list_create_2, index=flatten_3)
indexOf_6 = List.IndexOf(list=sort, element=getItemAtIndex_29)
boolean_7 = BoolSelector(true)
# note: OOTB node creates a list for every index.
# Clockwork uses the input to replace the indices in the one list.
# note: Custom Node: Clockwork v.2.3.0
replaceItemAtIndex = Custom[List.ReplaceItemAtIndex+](seq=cycle, indices=indexOf_6, replacement=boolean_7)  # package Clockwork for Dynamo 2.x; Replaces the item at a given index of a list by another item. Unlike the OOTB node, it can replace items at multiple indeces.
list_create_3 = List.Create(item0=replaceItemAtIndex, item1=cycle)
getItemAtIndex_30 = List.GetItemAtIndex(list=list_create_3, index=flatten_3)
flatten_4 = List.Flatten(list=getItemAtIndex_30)

# group (continued): Write Shared Parameters to family
# note: This Graph started out like this:
# https://www.youtube.com/watch?v=6Az1G0pla_k&t=327s
# In this video Gavin explained that the 'Parameter.AddSharedParameter'-node only works (or works best) with the 'Document.Current' from Orchid.
filterByBoolMask = List.FilterByBoolMask(list=sort, mask=flatten_4)
filterByBoolMask_2 = List.FilterByBoolMask(list=getItemAtIndex_22, mask=flatten_4)
filterByBoolMask_3 = List.FilterByBoolMask(list=getItemAtIndex_24, mask=flatten_4)
filterByBoolMask_4 = List.FilterByBoolMask(list=getItemAtIndex_26, mask=flatten_4)
filterByBoolMask_5 = List.FilterByBoolMask(list=flatten_4, mask=flatten_4)
filterByBoolMask_6 = List.FilterByBoolMask(list=eq_2, mask=flatten_4)

# group: create paramters, first instance then, after setting the [Type] parameter-file, the Type parameters.
code_block_30 = CodeBlock(parametername=filterByBoolMask.out) { parametername+"[Type]"; }
# note: Custom Node: Orchid
#    v. 230.0.2.7458
add = Orchid.RevitFamily.SharedParameter.Add(familyDocument=current, parameterName=filterByBoolMask.in, groupName=filterByBoolMask_2.in, type=filterByBoolMask_3.in, group=filterByBoolMask_4.in, instance=filterByBoolMask_5.in, reporting=filterByBoolMask_6.in)

# group: After setting instance parameters change to the [Type]-parameterfile
file_path_to_ifc_shared_2 = Filename("..\..\..\..\..\REVIT\IFC Shared Parameters-RevitIFCBuiltIn-Type_ALL.txt")  # "File Path to: IFC Shared Parameters-RevitIFCBuiltIn-Type_ALL.txt"; graph input
# note: Custom Node: Clockwork v.2.3.0
passthrough_3 = Custom[Passthrough](passThrough=file_path_to_ifc_shared_2, waitFor=add)
# note: Custom Node: Orchid
#    v. 230.0.2.7458
setFile_2 = Orchid.RevitProject.Parameters.SharedParameter.SetFile(file=passthrough_3)

# group (continued): create paramters, first instance then, after setting the [Type] parameter-file, the Type parameters.
# note: Custom Node: Clockwork v.2.3.0
passthrough_4 = Custom[Passthrough](passThrough=code_block_30, waitFor=setFile_2)
add_2 = Orchid.RevitFamily.SharedParameter.Add(familyDocument=current, parameterName=passthrough_4, groupName=filterByBoolMask_2.out, type=filterByBoolMask_3.out, group=filterByBoolMask_4.out, instance=filterByBoolMask_5.out, reporting=filterByBoolMask_6.out)

# group: restore shared parameterfile that was active before running.
# note: Custom Node: Clockwork v.2.3.0
passthrough_5 = Custom[Passthrough](passThrough=sharedParameterFile, waitFor=add_2)
# note: Custom Node: Orchid
#    v. 230.0.2.7458
setFile_3 = Orchid.RevitProject.Parameters.SharedParameter.SetFile(file=passthrough_5)

watch_2 = Watch()  # frozen; unwired: arg0

# group: Set the correct Category, either Doors or Windows.
code_block_31 = CodeBlock { "Ifc"; }
split_6 = String.Split(str=firstItem, separator0=code_block_31)
code_block_32 = CodeBlock(entity=split_6) { entity+"s"; }
byName = Category.ByName(name=code_block_32)
# note: Custom Node: Orchid
#    v. 230.0.2.7458
setCategory = Orchid.RevitFamily.Document.SetCategory(familyDocument=current, category=byName)

passthrough_6 = Custom[Passthrough](passThrough=current, waitFor=setCategory)

# group: Set Construction Type and Operation by setting the fomula.
string_18 = StringInput("""Construction Type
Operation""")
string_19 = StringInput("\n")
split_7 = String.Split(str=string_18, separator0=string_19)
string_20 = StringInput("\"")
# note: Since """ doesn't work....
code_block_33 = CodeBlock(quotationmark=string_20, constructiontypeandenumeration=ui_multipleinputform_2.User_Inputs) { quotationmark+constructiontypeandenumeration+quotationmark; }
# note: Custom Node: Orchid
#    v. 230.0.2.7458
set = Orchid.RevitFamily.Formula.Set(familyDocument=passthrough_6, parameterName=split_7, value=code_block_33)
